# Dynamo graph Dynamo-BIM-BOT.dyn (Dynamo 1.3.2.2480)

# group: SETTINGS
URL = StringInput("localhost:3000")

# group: BIM BOT POST EXAMPLE
URL_2 = StringInput("/square")
number = DoubleInput(8)
go = BoolSelector(true)
post_data = Python(IN[0]=URL, IN[1]=URL_2, IN[2]=number, IN[3]=go)
# ---------- post_data.python (43 lines) ----------
import clr
import sys
sys.path.append('C:\Program Files (x86)\IronPython 2.7\Lib')
import httplib, urllib, json, base64, time

clr.AddReference('ProtoGeometry')
from Autodesk.DesignScript.Geometry import *
#The inputs to this node will be stored as a list in the IN variables.
url = IN[0]
route = IN[1]
body = IN[2]
go = IN[3]

if go:

	# Make JSON object in proper format
    json_body = '{"number": "%s"}' % body

    #DB CONNECTION

    # Establish connection
    conn = httplib.HTTPConnection(url)

    # Define headers for authorizatio etc.
    headers = {"Content-type": "application/json"}

    # Send request
    conn.request('POST',route, json_body, headers)

    # Get response
    response = conn.getresponse()

    # Read response
    data = response.read()

    # Close db connection
    conn.close()

else:
    data = "off mode"

#Assign your output to the OUT variable.
OUT = data
# ----------------------------------------
watch = Watch(post_data)

# group: BIM BOT GET EXAMPLE
URL_3 = StringInput("/data")
go_2 = BoolSelector(true)
sparql_get = Python(IN[0]=URL, IN[1]=URL_3, IN[2]=go_2)
# ---------- sparql_get.python (39 lines) ----------
import clr
import sys
sys.path.append('C:\Program Files (x86)\IronPython 2.7\Lib')
import httplib, urllib, base64, json

clr.AddReference('ProtoGeometry')
from Autodesk.DesignScript.Geometry import *
#The inputs to this node will be stored as a list in the IN variables.
url = IN[0]
route = IN[1]
go = IN[2]

if go:
	
	# DB CONNECTION
	
	# Establish connection
	conn = httplib.HTTPConnection(url)
	
	# Define headers for authorizatio etc.
	headers = {"Accept": "text/plain"}
	
	# Send request
	conn.request('GET', route)
	
	# Get response
	response = conn.getresponse()
	
	# Read response
	data = response.read()
	
	# Close db connection
	conn.close()

else:
	data = 'off mode'
	
#Assign your output to the OUT variable.
OUT = data
# ----------------------------------------
watch_2 = Watch(sparql_get)
